# Grasshopper definition S2-intro-to-graphs.gh (Grasshopper 1.0.8)
# plug-ins: MeshEdit Components, Pufferfish, Bifocals, Weaverbird, ShapeDiverForGrasshopper

sddp = ShapeDiverDocumentPayload()
list = ValueList({"graphs-01-intro": 0, "graphs-02-graph-from-mesh": 1, "graphs-03-with-data": 2, "graphs-04-dual-graph": 3, "graphs-05-shorest-paths": 4}, selected="graphs-05-shorest-paths")
# Metrics
mesh = Mesh([<mesh referenced from the Rhino model> x4])
mesh_2 = Mesh([<mesh referenced from the Rhino model> x4])
mesh_3 = Mesh([<mesh referenced from the Rhino model> x4])
mesh_4 = Mesh([<mesh referenced from the Rhino model> x4])
mesh_5 = Mesh([<mesh referenced from the Rhino model> x4])
mesh_6 = Mesh([<mesh referenced from the Rhino model> x4])
mesh_7 = Mesh([<mesh referenced from the Rhino model> x4])
mesh_8 = Mesh([<mesh referenced from the Rhino model> x4])
mesh_9 = Mesh([<mesh referenced from the Rhino model> x4])
mesh_10 = Mesh([<mesh referenced from the Rhino model> x4])
mesh_11 = Mesh([<mesh referenced from the Rhino model> x2])
mesh_12 = Mesh([<mesh referenced from the Rhino model> x4])
mesh_13 = Mesh([<mesh referenced from the Rhino model> x2])
mesh_14 = Mesh([<mesh referenced from the Rhino model> x4])
mesh_15 = Mesh([<mesh referenced from the Rhino model> x4])
mesh_16 = Mesh([<mesh referenced from the Rhino model> x4])
mesh_17 = Mesh([<mesh referenced from the Rhino model> x4])
mesh_18 = Mesh([<mesh referenced from the Rhino model> x4])
mesh_19 = Mesh([<mesh referenced from the Rhino model> x4])
mesh_20 = Mesh([<mesh referenced from the Rhino model> x4])
mesh_21 = Mesh([<mesh referenced from the Rhino model> x4])
mesh_22 = Mesh([<mesh referenced from the Rhino model> x4])
mesh_23 = Mesh([<mesh referenced from the Rhino model> x2])
mesh_24 = Mesh([<mesh referenced from the Rhino model> x4])
mesh_25 = Mesh([<mesh referenced from the Rhino model> x4])
mesh_26 = Mesh([<mesh referenced from the Rhino model> x4])
mesh_27 = Mesh([<mesh referenced from the Rhino model> x4])
mesh_28 = Mesh([<mesh referenced from the Rhino model> x2])
mesh_29 = Mesh([<mesh referenced from the Rhino model> x4])
mesh_30 = Mesh([<mesh referenced from the Rhino model> x4])
mesh_31 = Mesh([<mesh referenced from the Rhino model> x4])
mesh_32 = Mesh([<mesh referenced from the Rhino model> x4])
mesh_33 = Mesh([<mesh referenced from the Rhino model> x4])
mesh_34 = Mesh([<mesh referenced from the Rhino model> x4])
mesh_35 = Mesh([<mesh referenced from the Rhino model> x4])
mesh_36 = Mesh([<mesh referenced from the Rhino model> x4])
mesh_37 = Mesh([<mesh referenced from the Rhino model> x4])
mesh_38 = Mesh([<mesh referenced from the Rhino model> x2])
mesh_39 = Mesh([<mesh referenced from the Rhino model> x4])
mesh_40 = Mesh([<mesh referenced from the Rhino model> x4])
mesh_41 = Mesh([<mesh referenced from the Rhino model> x4])
mesh_42 = Mesh([<mesh referenced from the Rhino model> x4])
mesh_43 = Mesh([<mesh referenced from the Rhino model> x4])
mesh_44 = Mesh([<mesh referenced from the Rhino model> x4])
mesh_45 = Mesh([<mesh referenced from the Rhino model> x4])
mesh_46 = Mesh([<mesh referenced from the Rhino model> x4])
mesh_47 = Mesh([<mesh referenced from the Rhino model> x4])
mesh_48 = Mesh([<mesh referenced from the Rhino model> x2])
mesh_49 = Mesh([<mesh referenced from the Rhino model> x4])
mesh_50 = Mesh([<mesh referenced from the Rhino model> x4])
mesh_51 = Mesh([<mesh referenced from the Rhino model> x4])
mesh_52 = Mesh([<mesh referenced from the Rhino model> x4])
mesh_53 = Mesh([<mesh referenced from the Rhino model> x4])
mesh_54 = Mesh([<mesh referenced from the Rhino model> x4])
mesh_55 = Mesh([<mesh referenced from the Rhino model> x4])
mesh_56 = Mesh([<mesh referenced from the Rhino model> x4])
graphs_02_graph_from_mesh = FilePath("C:\Users\david\Desktop\Session02\session02\graphs\graphs-02-graph-from-mesh.py")
graphs_05_shorest_paths = FilePath("C:\Users\marti\OneDrive\Documents\MPDA\14_AT_APY\03_Assignment_3_MeshStripes\00_GH\MPDA25-Assignment3\graphs-05-shorest-paths.py")
graphs_04_dual_graph = FilePath("C:\Users\david\Desktop\Session02\session02\graphs\graphs-04-dual-graph.py")
graphs_03_with_data = FilePath("C:\Users\david\Desktop\Session02\session02\graphs\graphs-03-with-data.py")
graphs_01_intro = FilePath("C:\Users\david\Desktop\Session02\session02\graphs\graphs-01-intro.py")
filter = StreamFilter(
    Gate=list,
    Stream0=graphs_01_intro,
    Stream1=graphs_02_graph_from_mesh,
    Stream2=graphs_03_with_data,
    Stream3=graphs_04_dual_graph,
    Stream4=graphs_05_shorest_paths)
quadmesh = Mesh(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)
trimesh = Mesh(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)
panel = Panel(filter)
file = ReadFile(File=filter, PerLineParse=False)
entwine = Entwine(
    Branch00=mesh,
    Branch01=mesh_2,
    Branch02=mesh_3,
    Branch03=mesh_4,
    Branch04=mesh_5,
    Branch05=mesh_6,
    Branch06=mesh_14,
    Branch07=mesh_7,
    Branch08=mesh_8,
    Branch09=mesh_15,
    Branch010=mesh_9,
    Branch011=mesh_10,
    Branch012=mesh_16,
    Branch013=mesh_17,
    Branch014=mesh_18,
    Branch015=mesh_19,
    Branch016=mesh_20,
    Branch017=mesh_21,
    Branch018=mesh_22,
    Branch019=mesh_23,
    Branch020=mesh_11,
    Branch021=mesh_24,
    Branch022=mesh_25,
    Branch023=mesh_26,
    Branch024=mesh_12,
    Branch025=mesh_13,
    Branch026=mesh_29,
    Branch027=mesh_30,
    Branch028=mesh_31,
    Branch029=mesh_32,
    Branch030=mesh_33,
    Branch031=mesh_34,
    Branch032=mesh_35,
    Branch033=mesh_36,
    Branch034=mesh_37,
    Branch035=mesh_27,
    Branch036=mesh_38,
    Branch037=mesh_39,
    Branch038=mesh_40,
    Branch039=mesh_41,
    Branch040=mesh_42,
    Branch041=mesh_43,
    Branch042=mesh_44,
    Branch043=mesh_45,
    Branch044=mesh_46,
    Branch045=mesh_47,
    Branch046=mesh_48,
    Branch047=mesh_49,
    Branch048=mesh_50,
    Branch049=mesh_51,
    Branch050=mesh_52,
    Branch051=mesh_53,
    Branch052=mesh_54,
    Branch053=mesh_55,
    Branch054=mesh_56,
    Branch055=mesh_28,
    FlattenInputs=True)
mesh_weldvertices = MeshWeldVertices(Mesh=entwine, Tolerance=0.01)  # -> RuntimeMessage, graft(Mesh)

# ----
# Mesh
mesh_57 = Mesh(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)

combine_clean = CombineClean(Meshes=mesh_weldvertices.Mesh)
shift_paths = ShiftPaths(Data=combine_clean, Offset=-1)
py3 = Python3Script(script=file, m=mesh_57, s=Slider(2, range=0..10), t=Slider(44, range=0..100))  # -> out, SP, a, b, c; inputs m: Mesh; unedited script template
explode = MeshExplode(Mesh=mesh_57, Interpolate=False)
mesh_58 = Mesh(shift_paths)
item = ListItem(List=explode, Index=py3.c, Wrap=True)

# ----
# Length of stripes
deconstruct_mesh = DeconstructMesh(Mesh=shift_paths)  # -> Vertices, Faces, Colours, Normals
list_length = ListLength(List=deconstruct_mesh.Faces)
shift_paths_2 = ShiftPaths(Data=list_length, Offset=-1)
panel_2 = Panel(shift_paths_2)
subtraction = Subtraction(A=shift_paths_2, B="4")
absolute = Absolute(Value=subtraction)
gradient = Gradient(
    LowerLimit="0",
    UpperLimit="4",
    Parameter=absolute,
    stops=[0: RGB(255, 255, 255), 0.23: RGB(255, 192, 128), 1: RGB(128, 0, 0)])
custom_preview = CustomPreview(Geometry=shift_paths, Material=gradient)

# ----
# Amount of stripes in patch
list_length_2 = ListLength(List=shift_paths)
subtraction_2 = Subtraction(A=list_length_2, B="4")
absolute_2 = Absolute(Value=subtraction_2)
gradient_2 = Gradient(
    LowerLimit="0",
    UpperLimit="4",
    Parameter=absolute_2,
    stops=[0: RGB(255, 255, 255), 0.23: RGB(255, 192, 255), 1: RGB(0, 0, 64)])
custom_preview_2 = CustomPreview(Geometry=shift_paths, Material=gradient_2)

face_normals = FaceNormals(Mesh=mesh_58)  # -> Centers, Normals

# ----
# Are other stripes perpendicular (0=yes)
# not perfect yet
mesh_explode = MeshExplode(Mesh=mesh_58, Interpolate=False)
panel_3 = Panel("""0 To 0.33
0.331 To 0.66
0.661 To 1""")

# ----
# Straightness of stripes
unroller = Unroller(Strip=shift_paths, Unroll=1)
weaverbird_s_naked_boundary = WeaverbirdsNakedBoundary(MeshClosedPolylines=unroller)  # -> graft(NakedCurves)
face_normals_2 = FaceNormals(Mesh=unroller)  # -> Centers, Normals
meshcorners = MeshCorners(Mesh=unroller, Angle=2.35619449)
curve_closest_point = CurveClosestPoint(Point=meshcorners, Curve=weaverbird_s_naked_boundary)  # -> Point, Parameter, Distance
shatter = Shatter(Curve=weaverbird_s_naked_boundary, Parameters=curve_closest_point.Parameter)
length = Length(Curve=shatter)
sort_list = SortList(Keys=length, ValuesValuesA=shatter)  # -> Keys, reverse(ValuesValuesA)
curve = Curve(sort_list.ValuesValuesA)
list_item = ListItem(List=curve, Index=0, Wrap=True)
curve_2 = Curve(simplify(list_item))

sort_along_curve = SortAlongCurve(Points=face_normals_2.Centers, Curve=curve_2)  # -> Points, Indices

list_item_2 = ListItem(List=mesh_explode, Index=sort_along_curve.Indices, Wrap=True)
mesh_join = MeshJoin(Meshes=list_item_2)
mesh_weldvertices_2 = MeshWeldVertices(Mesh=mesh_join, Tolerance=0.01)  # -> RuntimeMessage, Mesh
combine_clean_2 = CombineClean(Meshes=mesh_weldvertices_2.Mesh)
shift_paths_3 = ShiftPaths(Data=combine_clean_2, Offset=-1)
mesh_explode_2 = MeshExplode(Mesh=shift_paths_3, Interpolate=False)
weaverbird_s_midedge_subdivision = WeaverbirdsMidedgeSubdivision(MeshCurves=mesh_explode_2, Level=1, SmoothNakedEdges=0)
list_item_3 = ListItem(List=weaverbird_s_midedge_subdivision, Index=0, Wrap=True)  # -> Item1, Item
boundary_surfaces = BoundarySurfaces(Edges=list_item_3.Item1)
simple_mesh = SimpleMesh(Brep=boundary_surfaces)
mesh_59 = Mesh(simple_mesh)
shift_paths_4 = ShiftPaths(Data=mesh_59, Offset=-1)
mesh_join_2 = MeshJoin(Meshes=shift_paths_4)
mesh_weldvertices_3 = MeshWeldVertices(Mesh=mesh_join_2, Tolerance=0.01)  # -> RuntimeMessage, Mesh
shift_paths_5 = ShiftPaths(Data=mesh_weldvertices_3.Mesh, Offset=-1)
mesh_join_3 = MeshJoin(Meshes=shift_paths_5)
list_item_4 = ListItem(List=face_normals.Centers, Index=sort_along_curve.Indices, Wrap=True)
combine_clean_3 = CombineClean(Meshes=mesh_join_3)
interpolate = Interpolate(Vertices=list_item_4, Degree=3, Periodic=False, KnotStyle=1)  # -> Curve, Length, Domain
curve_closest_point_2 = CurveClosestPoint(Point=list_item_4, Curve=interpolate.Curve)  # -> Point, Parameter, Distance
flatten_tree = FlattenTree(Tree=combine_clean_3, Path="{0}")
evaluate_curve = EvaluateCurve(Curve=interpolate.Curve, Parameter=curve_closest_point_2.Parameter)  # -> Point, Tangent, Angle
item_index = ItemIndex(List=flatten_tree, Item=combine_clean_3)
unit_vector = UnitVector(Vector=evaluate_curve.Tangent)
cull_index = CullIndex(List=flatten_tree, Indices=item_index, Wrap=True)
average = Average(Input=unit_vector)
clash = Clash(FirstSet=simplify(combine_clean_3), SecondSet=simplify(cull_index), Distance=0, ResultLimit=100)  # -> ClashCount, ClashPoints, ClashRadii, FirstIndex, SecondIndex
unit_vector_2 = UnitVector(Vector=average)
shift_paths_6 = ShiftPaths(Data=simplify(unit_vector_2), Offset=-1)
average_2 = Average(Input=shift_paths_6)
vector_display_ex = VectorDisplayEx(Point=evaluate_curve.Point, Vector=unit_vector_2, Colour=RGB(0, 0, 0), Width=2)
flatten_tree_2 = FlattenTree(Tree=average_2, Path="{0}")
cull_index_2 = CullIndex(List=flatten_tree_2, Indices=item_index, Wrap=True)
list_item_5 = ListItem(List=cull_index_2, Index=clash.SecondIndex, Wrap=True)  # -> simplify(Item)
dot_product = DotProduct(VectorA=list_item_5, VectorB=average_2, Unitize=True)
absolute_3 = Absolute(Value=dot_product)
average_3 = Average(Input=absolute_3)
round_to_decimal_place = RoundToDecimalPlace(NumberX=average_3, DecimalPlace=Slider(2, range=0..10), RoundType=0)  # -> Rounded, Difference
find_domain = FindDomain(Domains=panel_3, Number=round_to_decimal_place.Rounded, Strict=False)  # -> Index, Neighbour
gradient_3 = Gradient(
    LowerLimit="0",
    UpperLimit="3",
    Parameter=find_domain.Index,
    stops=[0: RGB(255, 255, 255), 0.5: RGB(122, 182, 34), 1: RGB(0, 0, 0)])
custom_preview_3 = CustomPreview(Geometry=shift_paths_3, Material=gradient_3)

interpolate_2 = Interpolate(Vertices=sort_along_curve.Points, Degree=3, Periodic=False, KnotStyle=1)  # -> Curve, Length, Domain
curve_closest_point_3 = CurveClosestPoint(Point=sort_along_curve.Points, Curve=interpolate_2.Curve)  # -> Point, Parameter, Distance
evaluate_curve_2 = EvaluateCurve(Curve=interpolate_2.Curve, Parameter=curve_closest_point_3.Parameter)  # -> Point, Tangent, Angle
unit_vector_3 = UnitVector(Vector=evaluate_curve_2.Tangent)
shift_paths_7 = ShiftPaths(Data=simplify(evaluate_curve_2.Point), Offset=-1)
shift_paths_8 = ShiftPaths(Data=simplify(evaluate_curve_2.Tangent), Offset=-1)
list_item_6 = ListItem(List=unit_vector_3, Index=0, Wrap=True)  # -> Item1, Item
unit_vector_4 = UnitVector(Vector=shift_paths_8)
dot_product_2 = DotProduct(VectorA=list_item_6.Item, VectorB=list_item_6.Item1, Unitize=False)
vector_display_ex_2 = VectorDisplayEx(Point=shift_paths_7, Vector=unit_vector_4, Colour=RGB(0, 0, 0), Width=2)
absolute_4 = Absolute(Value=dot_product_2)
average_4 = Average(Input=absolute_4)  # -> simplify(ArithmeticMean)
gradient_4 = Gradient(
    LowerLimit="0",
    UpperLimit="1",
    Parameter=average_4,
    stops=[0.25: RGB(0, 0, 64), 0.995: RGB(255, 224, 192), 1: RGB(255, 255, 255)])
custom_preview_4 = CustomPreview(Geometry=graft(shift_paths), Material=gradient_4)
